# Grasshopper definition PrintTheseCurves_01.gh (Grasshopper 1.0.7)

# ---- group: Input Geometry
referencedcurves_crv = Curve([<curve referenced from the Rhino model> x3])
# PrintTheseCurves
# Create 3D-Printing Gcode from curves
singlecurve_crv = Curve(<curve referenced from the Rhino model>)
# Description: Gcode creation from a curve or set of curves in Rhino.
# 
# This definition takes curves from Rhino and converts them into Gcode-moves with extrusion.
# It is meant to be used with the HUGEFANCY 3D-Printer (www.Hugefancy.com).
# 
# Created By Robin Godwyll
# 
# License: MIT
curves = Curve(reparameterize(singlecurve_crv))

# ---- group: Basic print settings
printingheight_layerheight = Slider(4.704, range=-20.001..20)
segment_length = Slider(4.01, range=0.8..50)
extrusion_multiplication_factor = Panel("0.51")

# ---- group: Further print settings
extrusion = BooleanToggle(True)
temperature = Panel("260")
wait_for_temperature = BooleanToggle(True)
feedrate = Panel("550")
closedcurve_overlap_length = Slider(20.322, range=0.01..55)

# ---- group: Homing settings
home_x = BooleanToggle(False)
home_y = BooleanToggle(False)
home_z = BooleanToggle(True)
merge = Merge(Data1=home_x, Data2=home_y, Data3=home_z)

homingaxis_bool = Boolean(merge)

# ---- group: Further print settings
overlaplength_num = Number(closedcurve_overlap_length)
waitfortemp_bool = Boolean(wait_for_temperature)
temperature_int = Integer(temperature)
extrusion_bool = Boolean(extrusion)
feedrate_int = Integer(feedrate)

# ---- group: Basic print settings
printsegmentlength_num = Number(segment_length)
extrusionfactor_num = Number(extrusion_multiplication_factor)
# License: Copyright 2021 Robin Godwyll
# 
# Permission is hereby granted, free of charge, to any person obtaining a copy of this software and associated documentation files (the "Software"), to deal in the Software without restriction, including without limitation the rights to use, copy, modify, merge, publish, distribute, sublicense, and/or sell copies of the Software, and to permit persons to whom the Software is furnished to do so, subject to the following conditions:
# The above copyright notice and this permission notice shall be included in all copies or substantial portions of the Software.
# THE SOFTWARE IS PROVIDED "AS IS", WITHOUT WARRANTY OF ANY KIND, EXPRESS OR IMPLIED, INCLUDING BUT NOT LIMITED TO THE WARRANTIES OF MERCHANTABILITY, FITNESS FOR A PARTICULAR PURPOSE AND NONINFRINGEMENT. IN NO EVENT SHALL THE AUTHORS OR COPYRIGHT HOLDERS BE LIABLE FOR ANY CLAIM, DAMAGES OR OTHER LIABILITY, WHETHER IN AN ACTION OF CONTRACT, TORT OR OTHERWISE, ARISING FROM, OUT OF OR IN CONNECTION WITH THE SOFTWARE OR THE USE OR OTHER DEALINGS IN THE SOFTWARE.
printingheight_num = Number(printingheight_layerheight)

# ----
starting_gcode = Panel("""M17 ; enable all motors
G4 S2 ; wait for a few seconds
G91 ; use relative coordinates
G0 Z20 ; Move up 20 mm

G92 E0   ;reset Extruder position
M211 S0  ;disable soft endstops
G90  ;use absolute coordinates""")
gcode_before_print = Panel("""G0 Z10 ; Move up

; Set fanspeed via i2c
M260 R1
M260 A9
M260 B12; fan-header
M260 B0
M260 S1
M260 R1""")
ending_gcode = Panel("""G91 
;G0 Z5
G90

; set fanspeed via i2c
M260 R1
M260 A9
M260 B12; fan-header
M260 B20
M260 S1
M260 R1""")

# ---- group: File export settings
targetfolder_dir = FilePath("/Users/Robin/Projects/SimplePrinting/Gcode_Export/")

filename = Panel("Multiprint_38_")
save_file = Button()
target_path = Panel(targetfolder_dir)

filename_txt = Text(filename)
savebutton_bool = Boolean(save_file)
file_path = FilePath(target_path)

# ---- group: Add overlap to closed curves
overlaplength_num_2 = Number(overlaplength_num)
curves_2 = Curve(reparameterize(curves))

# Comment: This adds an optional overlap length to closed curves.
# 
# Closed Profiles/Curves may not be printed fully and result in a print with a small gap.
# To prevent this, a small overlap length is added to curves that are supposed to be closed.
panel = Panel("0.001 to 1")
evaluate_length = EvaluateLength(Curve=curves_2, Length=overlaplength_num_2, Normalized=False)  # -> Point, Tangent, Parameter
sub_curve = SubCurve(BaseCurve=curves_2, Domain=panel)
construct_domain = ConstructDomain(DomainStart=0, DomainEnd=evaluate_length.Parameter)
sub_curve_2 = SubCurve(BaseCurve=curves_2, Domain=construct_domain)
curveorder_number_size = Slider(12, range=0..100)
merge_2 = Merge(Data1=graft(sub_curve_2), Data2=graft(sub_curve))
end_points = EndPoints(Curve=sub_curve_2)  # -> Start, End
join_curves = JoinCurves(Curves=merge_2, Preserve=False)
point_list = PointList(Points=end_points.Start, Size=curveorder_number_size)
length = Length(Curve=join_curves)
sort_list = SortList(Keys=length, ValuesValuesA=join_curves)  # -> Keys, ValuesValuesA
closed = Closed(Curve=flatten(curves_2))  # -> Closed, Periodic
list_item = ListItem(List=sort_list.ValuesValuesA, Index="-1", Wrap=True)
pick_n_choose = PickNChoose(Pattern=closed.Closed, Stream0=curves_2, Stream1=flatten(list_item))

curvestoprint_crv = Curve(pick_n_choose)

# ---- group: Segment curves and move to printing-height
# Comment: Move the curves in Z-direction and divide them into segments for printing.
# 
# The curves are shifted upwards by defining a layerheight.
# The segment length defines how accurately each curve is printed.
# A short length results in more accurate prints but makes the Gcode files longer. If the length is very short the printer might slow down to process so many motion commands.
curvestoprint_crv_2 = Curve(curvestoprint_crv)
printsegmentlength_num_2 = Number(printsegmentlength_num)
printingheight_num_2 = Number(printingheight_num)

unit_z = UnitZ(Factor=printingheight_num_2)
move = Move(Geometry=curvestoprint_crv_2, Motion=unit_z)  # -> Geometry, Transform
divide_length = DivideLength(Curve=reparameterize(move.Geometry), Length=printsegmentlength_num_2)  # -> Points, Tangents, Parameters

printingpoints_pnt = Point(divide_length.Points)

printsegmentlength_num_3 = Number(printsegmentlength_num)
curvestoprint_crv_3 = Curve(curvestoprint_crv)
printingheight_num_3 = Number(printingheight_num)

unit_z_2 = UnitZ(Factor=printingheight_num_3)
move_2 = Move(Geometry=curvestoprint_crv_3, Motion=unit_z_2)  # -> Geometry, Transform
division = Division(A=printsegmentlength_num_3, B=2)
curve_to_polyline = CurveToPolyline(Curve=move_2.Geometry, ToleranceDistance=division, ToleranceAngle=0, MinEdge=printsegmentlength_num_3)  # -> Polyline, Segments
divide_curve = DivideCurve(Curve=curve_to_polyline.Polyline, Count="1", Kinks="true")  # -> Points, Tangents, Parameters

printingpoints_pnt_2 = Point(divide_curve.Points)

# ---- group: Get length of all printing segments
# Comment: Finds out how far each of the point is from the next
# 
# adds the appropriate amount of extrusion to each move
printingpoints_pnt_3 = Point(printingpoints_pnt_2)

polyline = PolyLine(Vertices=printingpoints_pnt_3, Closed="true")  # -> reparameterize(Polyline)
control_pts = ControlPoints(Curve=polyline)  # -> Points, Weights, Knots
curve_closest_point = CurveClosestPoint(Point=control_pts.Points, Curve=polyline)  # -> Point, Parameter, Distance
shatter = Shatter(Curve=polyline, Parameters=curve_closest_point.Parameter)
length_2 = Length(Curve=shatter)
text_tag = TextTag(Location=curve_closest_point.Point, Text=length_2)

printsegmentlengths_num = Number(length_2)

# ---- group: Create G0/G1 printing commands from points
printingpoints_pnt_4 = Point(printingpoints_pnt_2)
extrude_bool = Boolean(extrusion_bool)

deconstruct = Deconstruct(Point=printingpoints_pnt_4)  # -> XComponent, YComponent, ZComponent
merge_3 = Merge(Data1=graft(deconstruct.XComponent), Data2=graft(deconstruct.YComponent), Data3=graft(deconstruct.ZComponent))
format = Format(Format="{0:0.000}", Culture=127, Data0=merge_3)
panel_2 = Panel("""X
Y
Z""")
concatenate = Concatenate(FragmentA=panel_2, FragmentB=format)
tree_statistics = TreeStatistics(Tree=concatenate)  # -> Paths, Length, Count
stream_filter = StreamFilter(Gate=extrude_bool, Stream0="G0", Stream1="G1")
repeat_data = RepeatData(Data=stream_filter, Length=tree_statistics.Count)
list_length = ListLength(List=concatenate)
unflatten_tree = UnflattenTree(Tree=repeat_data, Guide=list_length)
merge_4 = Merge(Data1=unflatten_tree, Data2=concatenate)
text_join = TextJoin(Text=merge_4, Join=" ")
trim_tree = TrimTree(Tree=text_join, Depth=1)

printingmotions_txt = Text(trim_tree)

# ---- group: Accumulate Extrusion lenghts
printsegmentlengths_num_2 = Number(printsegmentlengths_num)

insert_items = InsertItems(List=printsegmentlengths_num_2, Item="0", Indices="0", Wrap=True)
cull_index = CullIndex(List=insert_items, Indices="-1", Wrap=True)
mass_addition = MassAddition(Input=cull_index)  # -> Result, PartialResults

cumulativeextrusionlength_num = Number(mass_addition.PartialResults)

# ---- group: Multiply with Extrusion Factor and turn into text
cumulativeextrusionlength_num_2 = Number(cumulativeextrusionlength_num)
extrusion_multiplication_factor_2 = Number(extrusionfactor_num)

multiplication = Multiplication(A=cumulativeextrusionlength_num_2, B=extrusion_multiplication_factor_2)
format_2 = Format(Format="{0:0.000}", Culture=127, Data0=multiplication)
concatenate_2 = Concatenate(FragmentA="E", FragmentB=format_2)

extrusioncommand_txt = Text(concatenate_2)

# ---- group: Feedrate
extrusion_bool_2 = Boolean(extrusion_bool)
feedrate_int_2 = Integer(feedrate_int)

comment = Panel("  ;set feedrate")
stream_filter_2 = StreamFilter(Gate=extrusion_bool_2, Stream0="G0  F", Stream1="G1  F")
merge_5 = Merge(Data1=stream_filter_2, Data2=feedrate_int_2, Data3=comment)
text_join_2 = TextJoin(Text=merge_5)

setfeedrate_txt = Text(text_join_2)

# ---- group: Temperature
waitfortemp_bool_2 = Boolean(waitfortemp_bool)
temperature_int_2 = Integer(temperature_int)

comment_2 = Panel("    ;set temperature to ")
stream_filter_3 = StreamFilter(Gate=waitfortemp_bool_2, Stream0="M104 S", Stream1="M105 S")
merge_6 = Merge(Data1=stream_filter_3, Data2=temperature_int_2, Data3=comment_2, Data4=temperature_int_2)
text_join_3 = TextJoin(Text=merge_6)

temperaturesetting_txt = Text(text_join_3)

# ---- group: Homing Options
homingaxis_bool_2 = Boolean(homingaxis_bool)

panel_3 = Panel("""X
Y
Z""")
cull_pattern = CullPattern(List=panel_3, CullPattern=homingaxis_bool_2)
merge_7 = Merge(Data1="G28", Data2=cull_pattern)
space = Panel(" ")
text_join_4 = TextJoin(Text=merge_7, Join=space)

homingsequence_txt = Text(text_join_4)

# ---- group: Add timestamp to filename
savebutton_bool_2 = Boolean(savebutton_bool)
filename_txt_2 = Text(filename_txt)

get_time_py = GhPythonScript(get_time=savebutton_bool_2)  # -> out, time_string; inputs get_time: Boolean
# ---------- get_time_py: Python ----------
"""Provides a scripting component.
    Inputs:
       
    Output:
        a: The a output variable"""

__author__ = "robin"

import rhinoscriptsyntax as rs
from datetime import datetime 

def give_time(): 
    time = datetime.now()
    time_string = time.strftime("%Y%m%d-%H%M")
    return time_string
    
if get_time: 
    time_string = give_time()
# ---------- end get_time_py ----------
file_extension = Panel(".gcode")
merge_8 = Merge(Data1=filename_txt_2, Data2=get_time_py.time_string, Data3=file_extension)
text_join_5 = TextJoin(Text=merge_8)

fullfilename_txt = Text(text_join_5)

# ---- group: Combine Motion (XYZ) and Extrusion (E) values
xyz_coordinates = Text(printingmotions_txt)
extrusion_length = Text(extrusioncommand_txt)

panel_4 = Panel("""G92 E0 ; reset extruder position
G4 S3 ; wait
G0 Z10""")
concatenate_3 = Concatenate(Fragment_A=xyz_coordinates, A=" ", Fragment_B=extrusion_length)
panel_5 = Panel("""0
1
-1""")
insert_items_2 = InsertItems(List=concatenate_3, Item=panel_4, Indices=panel_5, Wrap=True)

xyze_coordinates = Text(flatten(insert_items_2))

# ---- group: Merge Gcode
starting_gcode_2 = Text(starting_gcode)
homing = Text(homingsequence_txt)
temperature_2 = Text(temperaturesetting_txt)
final_movement = Text(ending_gcode)
feedrate_2 = Text(setfeedrate_txt)
xyze_coordinates_2 = Text(flatten(xyze_coordinates))

merge_9 = Merge(
    Data1=starting_gcode_2,
    Data2=homing,
    Data3=temperature_2,
    Data4=feedrate_2,
    Data5=gcode_before_print,
    Data6=xyze_coordinates_2,
    Data7=final_movement)
text_join_6 = TextJoin(Text=merge_9)

finalgcode_txt = Text(text_join_6)

# ---- group: Save Gcode file
file_path_2 = FilePath(file_path)
file_name_extension = Text(fullfilename_txt)
save_trigger = Boolean(savebutton_bool)
gcode = Text(finalgcode_txt)
ghpython_script = GhPythonScript(Save=save_trigger, Filepath=file_path_2, Filename=file_name_extension, Content=gcode)  # -> out, a; inputs Save: Boolean
# ---------- ghpython_script: Python ----------
__author__ = "robin godwyll"

import rhinoscriptsyntax as rs
import os 
fullpath = Filepath + "/" + Filename  #combine filepath and filename to get the target path

if Save:
    file_obj = open(fullpath,"w+")  #open the target path file, create it if it doesnt exist
    file_obj.write(Content)
    file_obj.close()
    a= "success"
# ---------- end ghpython_script ----------
success = Panel(ghpython_script.a)

# ----
panel_6 = Panel(finalgcode_txt)
